# Grasshopper definition PArking.gh (Grasshopper 1.0.7)
# Copyright: 2018
# plug-ins: Antflow

# >270 - Continue out booth depth
# approx 180 - Hatch
# <90 remove depth + maneuvrearea on 1 side
crv = Curve(<curve referenced from the Rhino model>)
crv_2 = Curve(<curve referenced from the Rhino model>)
crv_3 = Curve([<curve referenced from the Rhino model> x10])
number_slider = Slider(5, range=0..10)
c_script = CSharpScript(x=crv_2, y=crv_3)  # -> out, A; inputs x: Curve, y: list of Curve
# ---------- c_script: C# ----------
    List<Curve> CenterLines = new List<Curve>();
    foreach (Curve line in y)
    {
      Curve crvline = line;
      var curveEvent = Rhino.Geometry.Intersect.Intersection.CurveCurve(x, crvline, 0, 0);
      if (curveEvent != null)
      {
        List<double> curveT = new List<double>();
        for (int i = 0; i < curveEvent.Count; i++)
        {
          var crvLine = curveEvent[i];
          curveT.Add(crvLine.ParameterB);

        }

        Curve[] curveSplit = crvline.Split(curveT);
        CenterLines.AddRange(curveSplit);


        


      }

    }
    A = CenterLines;
# ---------- c_script: C# additional code ----------
  /// <summary>
  /// This method will be called once every solution, before any calls to RunScript.
  /// </summary>
  public override void BeforeRunScript()
  { }
  /// <summary>
  /// This method will be called once every solution, after any calls to RunScript.
  /// </summary>
  public override void AfterRunScript()
  { }
# ---------- end c_script ----------
parking = Parking(Boundery=crv_2)
crv_4 = Curve(c_script.A)
panel = Panel(c_script.out)
item = ListItem(List=crv_4, Index=Slider(10, range=0..10), Wrap=True)
len = Length(Curve=parking)
larger = LargerThan(FirstNumber=len, SecondNumber=6)  # -> LargerThan, OrEqualTo
cull = CullPattern(List=parking, CullPattern=invert(larger.OrEqualTo))
ccx = CurveCurve(CurveA=cull, CurveB=crv_2, UseTasks=False)  # -> Points, ParamsA, ParamsB
trig = TriangleTrigonometry()  # -> Alpha, Beta, Gamma, ALength, BLength, CLength
